# Dynamo graph MEP-Diffusors_in.dyn (Dynamo 0.8.0.950)

watch = Watch()
categories = Categories("DuctTerminal")
all_elements_of_category = ElementsOfCategory(categories)
string = StringInput("ALG_Mounted")
file_path = Filename("C:\Users\Tim\Desktop\OPB_KL\Raus.xlsx")
fromPath = FileObject(file_path)  # "File.FromPath"
string_2 = StringInput("Auslässe")
readFromFile = Excel.ReadFromFile(fromPath, string_2)
watch_2 = Watch(readFromFile)
transpose = List.Transpose(watch_2)
number = DoubleInput(1)
getItemAtIndex = List.GetItemAtIndex(list=transpose, index=number)
watch_3 = Watch(getItemAtIndex)
setParameterByName = Element.SetParameterByName(element=all_elements_of_category, parameterName=string, value=watch_3)
