# Dynamo graph MEP-Diffusors_out.dyn (Dynamo 0.8.0.950)

file_path = Filename("C:\Users\Tim\Desktop\OPB_KL\Raus")
string = StringInput("Auslässe")
number = DoubleInput(5)
number_2 = DoubleInput(0)
categories = Categories("DuctTerminal")
all_elements_of_category = ElementsOfCategory(categories)
string_2 = StringInput("Kennzeichen")
getParameterValueByName = Element.GetParameterValueByName(element=all_elements_of_category, parameterName=string_2)
watch = Watch(getParameterValueByName)
string_3 = StringInput("ALG_Mounted")
getParameterValueByName_2 = Element.GetParameterValueByName(element=all_elements_of_category, parameterName=string_3)
watch_2 = Watch(getParameterValueByName_2)
create = List.Create(watch, watch_2)
watch_3 = Watch(create)
transpose = List.Transpose(watch_3)
watch_4 = Watch(transpose)
writeToFile = Excel.WriteToFile(file_path, string, number, number_2, watch_4)
watch_5 = Watch(all_elements_of_category)
