# Dynamo graph MEP-Spaces.dyn (Dynamo 0.8.2.2392)

categories = Categories("MEPSpaces")
all_elements_of_category = ElementsOfCategory(categories)
watch = Watch(all_elements_of_category)
code_block = CodeBlock { "RLT_Raum_Luftwechsel"; "Volumen"; "Angegebener Zuluftstrom"; }
getParameterValueByName = Element.GetParameterValueByName(element=all_elements_of_category, parameterName=code_block.out0)
watch_2 = Watch(getParameterValueByName)
getParameterValueByName_2 = Element.GetParameterValueByName(element=all_elements_of_category, parameterName=code_block.out1)
code_block_2 = CodeBlock()
# ---------- code_block_2.designscript (2 lines) ----------
//Conversion Rate for internal units RME
101.940647731;
# ----------------------------------------
formula = Formula("(volume *change_rate)/Conversion", volume=getParameterValueByName_2, change_rate=getParameterValueByName, Conversion=code_block_2)
setParameterByName = Element.SetParameterByName(element=all_elements_of_category, parameterName=code_block.out2, value=formula)
watch_3 = Watch(getParameterValueByName_2)
watch_4 = Watch(formula)
